# Grasshopper definition galapagos about La Défense .gh (Grasshopper 1.0.7)

number_slider = Slider(6, range=-10..10)
number_slider_2 = Slider(6, range=0..10)
number_slider_3 = Slider(4, range=0..10)
number_slider_4 = Slider(4, range=0..10)
number_slider_5 = Slider(7, range=0..10)
number_slider_6 = Slider(-10, range=-10..10)
number_slider_7 = Slider(-5, range=-10..10)
number_slider_8 = Slider(5, range=-10..10)
number_slider_9 = Slider(0, range=-10..10)
number_slider_10 = Slider(-10, range=-10..10)
number_slider_11 = Slider(-10, range=-10..10)
number_slider_12 = Slider(1, range=-10..10)
xy_plane = XYPlane(Origin=Point(0, 0, 0))
center_box = CenterBox(Base=PlaneXY(0, 0, 0), X=number_slider_3, Y=number_slider_3, Z=Slider(7, range=0..20))
center_box_2 = CenterBox(Base=PlaneXY(0, 0, 0), X=number_slider_2, Y=number_slider_2, Z=Slider(14, range=0..20))
center_box_3 = CenterBox(Base=PlaneXY(0, 0, 0), X=number_slider_4, Y=number_slider_4, Z=Slider(20, range=0..20))
center_box_4 = CenterBox(Base=PlaneXY(0, 0, 0), X=number_slider_5, Y=number_slider_5, Z=Slider(3, range=0..20))
vector_xyz = VectorXYZ(XComponent=number_slider_10, YComponent=number_slider_11, ZComponent=0)  # -> Vector, Length
vector_xyz_2 = VectorXYZ(XComponent=number_slider_7, YComponent=number_slider_9, ZComponent=0)  # -> Vector, Length
vector_xyz_3 = VectorXYZ(XComponent=number_slider_8, YComponent=number_slider_12, ZComponent=0)  # -> Vector, Length
vector_xyz_4 = VectorXYZ(XComponent=number_slider, YComponent=number_slider_6, ZComponent=0)  # -> Vector, Length
vector_display = VectorDisplay(Anchor=xy_plane, Vector=vector_xyz.Vector)
move = Move(Geometry=center_box_2, Motion=vector_xyz.Vector)  # -> Geometry, Transform
move_2 = Move(Geometry=center_box, Motion=vector_xyz_2.Vector)  # -> Geometry, Transform
move_3 = Move(Geometry=center_box_3, Motion=vector_xyz_3.Vector)  # -> Geometry, Transform
move_4 = Move(Geometry=center_box_4, Motion=vector_xyz_4.Vector)  # -> Geometry, Transform
solid_union = SolidUnion(Breps=[move_3.Geometry, move.Geometry, move_2.Geometry, move_4.Geometry])
volume = Volume(Geometry=solid_union)  # -> Volume, Centroid
sort_list = SortList(Keys=volume.Volume, ValuesValuesA=solid_union)  # -> reverse(Keys), reverse(ValuesValuesA)
list_item = ListItem(List=sort_list.Keys, Index=Slider(0, range=0..100), Wrap=True)
list_item_2 = ListItem(List=sort_list.ValuesValuesA, Index=Slider(0, range=0..100), Wrap=True)
panel = Panel(sort_list.Keys)
galapagos = Galapagos(
    fitness=list_item,
    gene=[number_slider_10, number_slider_11, number_slider_7, number_slider_9, number_slider_8, number_slider_12, number_slider, number_slider_6])
