# Grasshopper definition cellularautomata.gh (Grasshopper 1.0.7)

# CONWAY'S GAME OF LIFE FOR GRASSHOPPER
# JONAS KOLARIK 13 APR 2020
grid_size = Panel("64")
# Initial 2D T/F array
# Random
seed = Slider(755, range=0..1000)
# Img sampler
range = Range(Domain=Domain(0, 1), Steps=expr("x-1", grid_size))
pt = ConstructPoint(XCoordinate=range, YCoordinate=graft(range), ZCoordinate=0)  # -> simplify(Point)
series = Series(Start=seed, Step=seed, Count=grid_size)  # -> graft(Series)
image = ImageSampler(pt, Filter="Value", Interpolate=False, Umax=1, Umin=0, Vmax=1, Vmin=0, Wrap=1)
random = Random(Range=Domain(0, 1), Number=grid_size, Seed=series, Integers=True)  # -> simplify(Random)
bool = Boolean(invert(image))
bool_2 = Boolean(random)
cell_size = Panel("5")
int = Integer(grid_size)
underpopulation_limit = Slider(2, range=0..8)
overpopulation_limit = Slider(3, range=0..8)
resurrection_limit = Slider(3, range=0..8)
# Display grid
xy = XYPlane(Origin=Point(0, 0, 0))
sqgrid = Square(Plane=xy, Size=cell_size, ExtentX=expr("x-1", int), ExtentY=expr("x-1", int))  # -> Cells, Points
generations = Panel("50")
# GAME OF LIFE
bool_3 = Boolean(bool)
planesrf = PlaneSurface(Plane=sqgrid.Points, XSize=cell_size, YSize=cell_size)  # -> simplify(Plane)
c_cgol = CSharpScript(init=bool_3, undLim=underpopulation_limit, ovrLim=overpopulation_limit, resLim=resurrection_limit, g=generations)  # -> out, A; inputs init: tree of Boolean, undLim: Int32, ovrLim: Int32, resLim: Int32, g: Int32
# ---------- c_cgol: C# usings ----------
using System.Diagnostics;
# ---------- c_cgol: C# ----------
    // CONWAY'S GAME OF LIFE FOR GRASSHOPPER
    // JONAS KOLARIK 13 APR 2020

    // Timer:

    Stopwatch timer = new Stopwatch();

    // Get grid size:

    x = init.DataCount;
    y = init.BranchCount;
    x /= y;
    Print("Grid size is {0} x {1}.", x, y);

    // Fill the tree with blanks:
    storage.Clear();

    for (int i = 0; i < g; i++)
    {
      for (int j = 0; j < y; j++)
      {
        GH_Path pth = new GH_Path(i, j);

        for (int k = 0; k < x; k++)
        {
          storage.Add(false, pth);
        }
      }
    }

    // Move the initial state(init) to the (0) path:

    for (int i = 0; i < y; i++)
    {
      for (int j = 0; j < x; j++)
      {
        storage.Branch(0, i)[j] = init.Branch(i)[j];
      }
    }

    // PLAY THE GAME OF LIFE!

    for (int i = 1; i < g; i++)
    {
      timer.Start();

      for (int j = 0; j < y; j++)
      {
        for (int k = 0; k < x; k++)
        {
          int neighbors = Check(i, k, j);
          bool alive = storage.Branch(i - 1, j)[k];
          if (alive)
          {
            if (neighbors >= undLim && neighbors <= ovrLim)
              alive = true;
            else
              alive = false;
          }
          else
          {
            if (neighbors == resLim)
              alive = true;
            else
              alive = false;
          }
          storage.Branch(i, j)[k] = alive;
        }
      }

      Print("Gen {0} took {1} ms to compute.", i, timer.ElapsedMilliseconds.ToString());
      timer.Restart();

    }

    // Output:

    A = storage;
# ---------- c_cgol: C# additional code ----------
  // GAME OF LIFE TREE

  public DataTree<bool> storage = new DataTree<bool>();

  public int x;
  public int y;


  // PIXEL NEIGHBORHOOD METHOD

  private int Check(int gen, int tempX, int tempY)
  {
    gen--;
    int sum = 0;

    for (int i = tempY - 1; i <= tempY + 1; i++)
    {
      if (i < 0 || i >= y)
        continue;

      for(int j = tempX - 1; j <= tempX + 1; j++)
      {
        if (j < 0 || j >= x)
          continue;

        if (storage.Branch(gen, i)[j])
          sum++;
      }
    }
    if (storage.Branch(gen, tempY)[tempX])
      sum--;

    //Print("Sum({0},{1}) = {2}.", tempX, tempY, sum);
    return sum;
  }
# ---------- end c_cgol ----------
flip = FlipMatrix(Data=planesrf)  # -> flatten(Data)
generation = Slider(49, range=0..49)
bbox = BoundingBox(Content=flip, Plane=PlaneXY(0, 0, 0), UnionBox=True)  # -> Box, Box_2
debrep = DeconstructBrep(Brep=bbox.Box)  # -> Faces, Edges, Vertices
crv = Curve(debrep.Edges)
int_2 = Integer(generation)
trim = TrimTree(Tree=c_cgol.A, Depth=1)
# Stack generations above each other
series_2 = Series(Start=0, Step=1, Count=generation)
range_2 = Range(Domain=Domain(0, 1), Steps=expr("x-1", int_2))  # -> reverse(Range)
series_3 = Series(Start=0, Step=1, Count=int_2)
branch = TreeBranch(Tree=trim, Path=series_2, MaintainPaths=True)
# Preview single generation
trim_2 = TrimTree(Tree=c_cgol.A, Depth=1)
Z = UnitZ(Factor=series_3)  # -> simplify(graft(UnitVector))
gradient = Gradient(
    LowerLimit=0,
    UpperLimit=1,
    Parameter=range_2,
    stops=[0: RGB(234, 38, 0), 0.25: RGB(234, 126, 0), 0.5: RGB(254, 244, 84), 0.75: RGB(173, 203, 249), 1: RGB(75, 107, 169)])
branch_2 = TreeBranch(Tree=trim_2, Path=generation, MaintainPaths=True)
cull = CullPattern(List=flip, CullPattern=branch)
move = Move(Geometry=cull, Motion=Z)  # -> Geometry, Transform
bool_4 = Boolean(branch_2)
geo = Geometry(flip)
cull_2 = CullPattern(List=geo, CullPattern=bool_4)
preview = CustomPreview(Geometry=move.Geometry, Material=simplify(graft(gradient)))
