# Grasshopper definition Radiation Analysis  about La Défense.gh (Grasshopper 1.0.7)

ladybug = Ladybug_Ladybug()  # -> Vviiiiiiiiiizzz; plug-in component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
file_path = FilePath("F:\la defence\RFA\FRA_Paris.Orly.071490_IWEC.epw")
panel = Panel(ladybug)
gencumulativeskymtx = Ladybug_GenCumulativeSkyMtx(epwFile=file_path, skyDensity=0, useOldRes=True, runIt=Toggle(True))  # -> readMe, cumulativeSkyMtx; plug-in component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
selectskymtx = Ladybug_selectSkyMtx(cumulativeSkyMtx=gencumulativeskymtx.cumulativeSkyMtx, removeDiffuse=False, removeDirect=False)  # -> readMe, selectedSkyMtx; plug-in component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

# ---- group: test geometry
brep = Brep([<brep referenced from the Rhino model> x6])

# ----
toggle = BooleanToggle(True)

number_slider = Slider(4.4, range=0..10)
wires = BrepWireframe(Brep=brep, Density=-1)
ext = ExtendCurve(Curve=wires, Type=0, Start=number_slider, End=number_slider)
preview = CustomPreview(Geometry=ext, Shader=ColourSwatch(SwatchColor=RGB(0, 0, 0)))

radiationanalysis = Ladybug_RadiationAnalysis(
    geometry=flatten(brep),
    context=flatten(brep),
    gridSize="2",
    disFromBase=".01",
    selectedSkyMtx=flatten(selectskymtx.selectedSkyMtx),
    parallel=toggle,
    runIt=toggle)  # -> readMe, contextMesh, analysisMesh, testPts, testVec, port, radiationResult, radiationMesh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; plug-in component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
panel_2 = Panel(radiationanalysis.radiationResult)
